% Simulink data dictionary ros2webots_go_to_point_controller_model_cg.sldd

laterl_PID_kp = Simulink.Parameter(1, StorageClass="Const", DataType="double")  % Lateral PID controller gain: Kp
longitudinal_speed_gain = Simulink.Parameter(0.2, StorageClass="Const", DataType="double")  % The gain thay manipulate main state machine velocity command
laterl_PID_kd = Simulink.Parameter(0, StorageClass="Const", DataType="double")  % Lateral PID controller gain: Kd
laterl_PID_ki = Simulink.Parameter(0.2, StorageClass="Const", DataType="double")  % Lateral PID controller gain: Ki