% Simulink data dictionary ros2webots_localization_model.sldd

low_pass_noise_frequency = Simulink.Parameter(0.5, StorageClass="Const", DataType="double", Unit="Hz")  % Frequency bound of the low pass filter that emove the noise with a higher frequency
manual_derivative_dt_threshold = Simulink.Parameter(0.001, StorageClass="Const", DataType="double", Unit="sec")  % Safe deravative time threshold parameter (do dx/dt if dt > threshold)
wheel_based_localization_y_initial_coord = Simulink.Parameter(0, StorageClass="Const", DataType="double", Unit="m")  % Initial y coordinate of localization using only wheel pose data
wheel_based_localization_x_initial_coord = Simulink.Parameter(0, StorageClass="Const", DataType="double", Unit="m")  % Initial x coordinate of localization using only wheel pose data
rosbot_wheel_radius = Simulink.Parameter(0.043, StorageClass="Const", DataType="double", Unit="m")  % ROSBot wheel radius